# Grasshopper definition test 01.gh (Grasshopper 1.0.7)
# plug-ins: Robot

F = File(["C:\Users\Pm\Desktop\ROBOT_BI\FlatsOBD\ver2\1.5S_type1_47.23_b_L_D.json", "C:\Users\Pm\Desktop\ROBOT_BI\FlatsOBD\ver2\1.5S_type2_49.15_b_R_U.json", "C:\Users\Pm\Desktop\ROBOT_BI\FlatsOBD\ver2\1.5S_type3_50.79_b_R_U.json", "C:\Users\Pm\Desktop\ROBOT_BI\FlatsOBD\ver2\1.5S_type4_50.69_b_L_D.json", "C:\Users\Pm\Desktop\ROBOT_BI\FlatsOBD\ver2\1.5S_type5_50.40_b_L_D.json", "C:\Users\Pm\Desktop\ROBOT_BI\FlatsOBD\ver2\1.5XS_type1_44.36_b_L_D.json", "C:\Users\Pm\Desktop\ROBOT_BI\FlatsOBD\ver2\1M_type1_41.62_m_R_U.json", "C:\Users\Pm\Desktop\ROBOT_BI\FlatsOBD\ver2\1M_type2_39.98_m_R_U.json", "C:\Users\Pm\Desktop\ROBOT_BI\FlatsOBD\ver2\1M_type3_38.34_m_R_U.json", "C:\Users\Pm\Desktop\ROBOT_BI\FlatsOBD\ver2\1M_type4_41.62_m_L_U.json", "C:\Users\Pm\Desktop\ROBOT_BI\FlatsOBD\ver2\1S_type1_35.06_m_L_D.json", "C:\Users\Pm\Desktop\ROBOT_BI\FlatsOBD\ver2\2M_type1_60.34_m_R_U.json", "C:\Users\Pm\Desktop\ROBOT_BI\FlatsOBD\ver2\2M_type2_60.51_m_R_U.json", "C:\Users\Pm\Desktop\ROBOT_BI\FlatsOBD\ver2\2M_type3_57.57_b_L_U.json", "C:\Users\Pm\Desktop\ROBOT_BI\FlatsOBD\ver2\2S_type1_53.95_m_L_D.json", "C:\Users\Pm\Desktop\ROBOT_BI\FlatsOBD\ver2\2S_type2_53.20_b_L_U.json", "C:\Users\Pm\Desktop\ROBOT_BI\FlatsOBD\ver2\2S_type3_53.02_b_L_U.json", "C:\Users\Pm\Desktop\ROBOT_BI\FlatsOBD\ver2\2S_type4_53.35_m_R_D.json", "C:\Users\Pm\Desktop\ROBOT_BI\FlatsOBD\ver2\2S_type5_50.67_b_L_D.json", "C:\Users\Pm\Desktop\ROBOT_BI\FlatsOBD\ver2\3M_type1_80.92_a_R_U.json", "C:\Users\Pm\Desktop\ROBOT_BI\FlatsOBD\ver2\3M_type1_82.44_b_L_D.json", "C:\Users\Pm\Desktop\ROBOT_BI\FlatsOBD\ver2\3M_type2_82.63_b_L_D.json", "C:\Users\Pm\Desktop\ROBOT_BI\FlatsOBD\ver2\3M_type3_82.73_b_L_D.json", "C:\Users\Pm\Desktop\ROBOT_BI\FlatsOBD\ver2\3M_type5_79.38_b_L_U.json", "C:\Users\Pm\Desktop\ROBOT_BI\FlatsOBD\ver2\3S_type1_73.86_bw_L_U.json"])
F_2 = File("C:\Users\Pm\Desktop\ROBOT_BI\Modules\Apt_combinations\combinations_5.txt")
file = ReadFile(File=F, PerLineParse=False)
file_2 = ReadFile(File=F_2, PerLineParse=False)
readflat = ReadFlat(JSON=file)  # -> flatten(Flat)
panel = Panel(readflat)
